# Grasshopper definition Export-Image-with-Sequence-Test-Sequence-Twist.ghx (Grasshopper 0.9.76)
# plug-ins: Python Interpreter

number_slider = Slider(90, range=0..100)
panel = Panel("C:\Users\yoshioca\Documents\Export-Image-with-Sequence\Example-TwistBox\images\")
python = PythonScript(xy_dom="10", step_angle=number_slider)  # -> out, a; disabled
# ---------- python: Python ----------
import rhinoscriptsyntax as rs
import math


def rects():
    rects = []
    
    for i in xrange(xy_dom+1):
        pt = rs.coerce3dpoint(rs.AddPoint(xy_dom*0.5*-1, xy_dom*0.5*-1, i))
        plane = rs.MovePlane(rs.WorldXYPlane(), pt)
        rect = rs.AddRectangle(plane, xy_dom, xy_dom)
        rects.append(rect)
       
    return rects


def rotate_loft(rects, angle):
    
    rects_rot = []
    loft_obj = []
    
    tmp_angle = 0.0
    for i in xrange(len(rects)):
        tmp_rect = rects[i]
        #print(tmp_rect) # guid
        rect_rot = rs.RotateObject(tmp_rect, (0,0,0), tmp_angle)
        #print(type(tmp_angle))
        tmp_angle += angle
        rects_rot.append(rect_rot)
    
    loft_obj = rs.AddLoftSrf(rects_rot, None, None, 1)
    rs.CapPlanarHoles(loft_obj)
    print(type(loft_obj))
    return loft_obj






rects = rects()
debug = rotate_loft(rects, step_angle)

print(debug)

a = debug
# ---------- end python ----------
python_2 = PythonScript(xy_dom="10", step_angle=number_slider)  # -> out, a
# ---------- python_2: Python ----------
import rhinoscriptsyntax as rs
import ghpythonlib.components as ghpc

import copy
import math


debug = []

def rects():
    rects = []
    
    for i in xrange(xy_dom+1):
        pt = rs.coerce3dpoint(rs.AddPoint(xy_dom*0.5*-1, xy_dom*0.5*-1, i))
        plane = rs.MovePlane(rs.WorldXYPlane(), pt)
        rect = rs.AddRectangle(plane, xy_dom, xy_dom)
        rects.append(rect)
       
    return rects


def rotate_lofts_Right(angle):
    
    loft_objs = []
    loft_objs_objs = []
    
    rects_ = rects()
    
    for j in xrange(angle+1):        
        
        rects_rot = []
        tmp_angle = 0
        
        for i in xrange(len(rects_)):
            tmp_rect = rects_[i]
            #print(tmp_rect) # guid
#            rect_rot = rs.RotateObject(tmp_rect, (0,0,0), tmp_angle)
            rect_rot, v1 = ghpc.Rotate(rs.coercecurve(tmp_rect), math.radians(tmp_angle), rs.WorldXYPlane())
            #print(tmp_angle)
            #print(type(tmp_angle))
            tmp_angle += j
            rects_rot.append(rect_rot)
        
        #print(rects_rot)
        #print("---")
        
        loft_obj = rs.AddLoftSrf(rects_rot, None, None, 1)
        rs.CapPlanarHoles(loft_obj)
        #print(loft_obj)
        #print(type(loft_obj))
        #print(len(loft_obj))
        #print("---")
        loft_objs.append(loft_obj[0])
    #print(len(loft_objs))
    return loft_objs


def rotate_lofts_Left(angle):
    
    loft_objs = []
    loft_objs_objs = []
    
    rects_ = rects()
    
    for j in xrange(angle+1):        
        
        rects_rot = []
        tmp_angle = 0
        
        for i in xrange(len(rects_)):
            tmp_rect = rects_[i]
            #print(tmp_rect) # guid
#            rect_rot = rs.RotateObject(tmp_rect, (0,0,0), tmp_angle)
            rect_rot, v1 = ghpc.Rotate(rs.coercecurve(tmp_rect), math.radians(tmp_angle), rs.WorldXYPlane())
            #print(tmp_angle)
            #print(type(tmp_angle))
            tmp_angle -= j
            rects_rot.append(rect_rot)
        
        #print(rects_rot)
        #print("---")
        
        loft_obj = rs.AddLoftSrf(rects_rot, None, None, 1)
        rs.CapPlanarHoles(loft_obj)
        #print(loft_obj)
        #print(type(loft_obj))
        #print(len(loft_obj))
        #print("---")
        loft_objs.append(loft_obj[0])
    #print(len(loft_objs))
    return loft_objs


def merge():
    
    a = []
    
    Right = rotate_lofts_Right(step_angle)
    Left = rotate_lofts_Left(step_angle)
    
    Right_reverse = copy.copy(Right)
    Right_reverse.reverse()
    Left_reverse = copy.copy(Left)
    Left_reverse.reverse()
    
    for i in xrange(len(Left) -1):
        a.append(Left[i])
        
    for i in xrange(len(Left_reverse) -1):
        a.append(Left_reverse[i])
    
    for i in xrange(len(Right)-1):
        a.append(Right[i])
        
    for i in xrange(len(Right_reverse)-1):
        a.append(Right_reverse[i])
    
    print(len(a))
    
    return a



a = merge()

#Right = rotate_lofts_Right(step_angle)
#b = Right
# ---------- end python_2 ----------
viewer = ParamViewer(python_2.a)
python_3 = PythonScript(breps=python_2.a, path=panel, type=".png", toggle=Toggle(False))  # -> out, a; inputs breps: list of Brep
# ---------- python_3: Python ----------
import rhinoscriptsyntax as rs
import Rhino
import scriptcontext as sc
import ghpythonlib.components as ghpc


sc.doc = ghdoc


if toggle:
    
    for i in xrange(len(breps)):
#    for i in xrange(90, 95):
    
        
        name_format = "%03d"%i
        export_name = path + str(name_format) + type
        
        
        sc.doc = Rhino.RhinoDoc.ActiveDoc

        brep = ghpc.ListItem(breps, i)
#        brep_obj = rs.coercebrep(brep)
        sc.doc.Objects.AddBrep(brep)
        
        
        
        query_cap = "-ViewCaptureToFile "+ \
            export_name + \
            " W=1920 H=1080 S=1 D=_No R=_No A=_No T=_Yes " +\
            " _Enter "
        
        
        query_del = " _SelAll Delete "
        
        query = query_cap + query_del                
        
        rs.Command(query)
#        print(query)
        
        sc.doc = ghdoc
# ---------- end python_3 ----------
item = ListItem(List=python_2.a, Index=Slider(90, range=0..359), Wrap=True)
