# Grasshopper definition Export-Image-with-Sequence-Test-Sequence.ghx (Grasshopper 0.9.76)
# plug-ins: Python Interpreter

# ---- group: X
panel = Panel("C:\Users\yoshioca\Documents\Export-Image-with-Sequence\Test-Sequence\")  # disabled
panel_2 = Panel(".png")  # disabled
panel_3 = Panel("10")  # disabled
brep = Brep([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])  # disabled
toggle = BooleanToggle(False)  # disabled
python = PythonScript(path=panel, name=panel_3, type=panel_2, toggle=toggle)  # -> out, a, rot_deg; inputs name: Int32; disabled
# ---------- python: Python ----------
import rhinoscriptsyntax as rs





for i in xrange(name):
    
    i_format = "%03d"%i
    export_name = path + str(i_format) + type
    
    rot_deg = i*2
    
    if toggle:
        
        query = "-ViewCaptureToFile "+ \
            export_name + \
            " W=1920 H=1080 S=1 D=_No R=_No A=_No T=_Yes " +\
            " _Enter "
            
            
        rs.Command(query)
        
        print(query)
# ---------- end python ----------
rad = Radians(Degrees=python.rot_deg)  # disabled
rotate = Rotate(Geometry=brep, Angle=rad, Plane=PlaneXY(0, 0, 0))  # -> Geometry, Transform; disabled
brep_2 = Brep(rotate.Geometry)  # disabled

# ----
panel_4 = Panel("C:\Users\yoshioca\Documents\Export-Image-with-Sequence\Test-Sequence\")
brep_3 = Brep([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])
python_2 = PythonScript(breps=brep_3, path=panel_4, name="180", type=".png", toggle=Toggle(False))  # -> out, a; inputs breps: list, name: Int32
# ---------- python_2: Python ----------
import rhinoscriptsyntax as rs
import scriptcontext as sc
import Rhino


def rot_objs(objs, deg):
    
    objs_rot = []
    
    for i in xrange(len(objs)):
        obj = objs[i]
        obj = rs.coercebrep(rs.RotateObject(obj, (0,0,0), deg))
        objs_rot.append(obj)
        
    return objs_rot



def bake_brep(breps):
    
    for i in xrange(len(breps)):
        
        sc.doc = Rhino.RhinoDoc.ActiveDoc
        
        brep = breps[i]
        brep = rs.coercebrep(brep)
        sc.doc.Objects.AddBrep(brep)
        #print len(breps)
        #print i
        #print "---"





sc.doc = ghdoc




if toggle:
    
    for i in xrange(int(name)):
        
        export_name = path + str("%03d"%i) + type
        
        
        breps_result = rot_objs(breps, 2)
        bake_brep(breps_result)
        
        
        
        query_cap = "-ViewCaptureToFile "+ \
            export_name + \
            " W=1920 H=1080 S=1 D=_No R=_No A=_No T=_Yes  _Enter "
            
        query_del = " _SelAll _Delete "
        
        query = query_cap + query_del
        
        
        rs.Command(query)
        
        
        sc.doc = ghdoc
# ---------- end python_2 ----------
