# Grasshopper definition Export-Image-Test.ghx (Grasshopper 0.9.76)
# plug-ins: Python Interpreter

panel = Panel("C:\Users\yoshioca\Documents\Export-Image-with-Sequence\Test\")
pt = Point(Point(0, 0, 0))
pt_2 = Point(Point(100, 100, 100))
box = Box2Pt(PointA=pt, PointB=pt_2, Plane=PlaneXY(0, 0, 0))
X = UnitX(Factor=Slider(150, range=0..1000))
move = Move(Geometry=box, Motion=X)  # -> Geometry, Transform
move_2 = Move(Geometry=move.Geometry, Motion=X)  # -> Geometry, Transform
python = PythonScript(path=panel, name="rhino-wireframe", type=".png", toggle=Toggle(False))  # -> out, a
# ---------- python: Python ----------
import rhinoscriptsyntax as rs

export_name = path + name + type

if toggle:
    
    query = "-ViewCaptureToFile "+ \
        export_name + \
        " W=1920 H=1080 S=1 D=_No R=_No A=_No T=_Yes " +\
        " _Enter "
        
        
    rs.Command(query)
    
    print(query)
# ---------- end python ----------
debrep = DeconstructBrep(Brep=move_2.Geometry)  # -> Faces, Edges, Vertices
colour = ColourPicker(PickedColour=RGB(59, 201, 255))
preview = CustomPreview(Geometry=box, Shader=colour)
crv = Curve(debrep.Edges)
