# Grasshopper definition Export-Image-with-Sequence-Test.ghx (Grasshopper 0.9.76)
# plug-ins: Python Interpreter

panel = Panel("C:\Users\yoshioca\Documents\Export-Image-with-Sequence\Test\")
python = PythonScript(path=panel, name="hoge", type=".png", toggle=Toggle(False))  # -> out, a
# ---------- python: Python ----------
import rhinoscriptsyntax as rs

export_name = path + name + type

if toggle:
    
    query = "-ViewCaptureToFile "+ \
        export_name + \
        " W=1920 H=1080 S=1 D=_No R=_No A=_No T=_Yes " +\
        " _Enter "
        
        
    rs.Command(query)
    
    print(query)
# ---------- end python ----------
